# Grasshopper definition Test Nelly.gh (Grasshopper 1.0.8)

read_file = ReadFile(File="C:\MPDA\MPDA26_Session05_Abril\01test", PerLineParse=False)
pt = Point(Point(-32.22195396, 40.99240017, 0))
py3 = Python3Script(script=read_file)  # -> out, a; unedited script template
pythoextrusionsn_3_script = Python3Script(
    script=read_file,
    rowCount=Slider(10, range=0..10),
    columnCount=Slider(10, range=0..10),
    cellSize=Slider(6.37, range=0..10),
    attractorPoint=pt,
    minHeight=Slider(5.69, range=0..10),
    maxHeight=Slider(5.69, range=0..10))  # -> out, a; inputs rowCount: Int32, columnCount: Int32, cellSize: Int32, attractorPoint: Point3d, minHeight: Double, maxHeight: Double; unedited script template
panel = Panel(read_file)
