# Grasshopper definition finalvoronoi.gh (Grasshopper 1.0.8)

read_file = ReadFile(File="C:\MPDA\MPDA_Session05_group_assignment\finalvoronoi.py", PerLineParse=False)

# ----
# Voronoi Pattern extruction
number_slider = Slider(100, range=0..100)
number_slider_2 = Slider(20, range=0..100)
number_slider_3 = Slider(100, range=0..100)
script = Script(
    script=read_file,
    width=Slider(100, range=0..100),
    depth=number_slider,
    n_cells=Slider(10, range=0..100),
    offset_dist=Slider(4.41, range=0..5),
    h_min=number_slider_2,
    h_max=number_slider_3,
    seed=Slider(58, range=0..100))  # -> out, a, b; inputs width: Double, depth: Double, n_cells: Int32, offset_dist: Double, h_min: Double, h_max: Double, seed: Int32
#   port script: Script to execute
# ---------- script: Python ----------
import Rhino.Geometry as rg
import ghpythonlib.components as gh
import random  # Importamos la librería nativa de Python para generar aleatoriedad

# 1. El Terreno Base (Dominio)
plano = rg.Plane.WorldXY
rectangulo = gh.Rectangle(plano, width, depth, 0)[0] 

# 2. Poblar con puntos 
puntos = gh.Populate2D(rectangulo, n_cells, seed)

# 3. Generar las celdas de Voronoi
celdas = gh.Voronoi(puntos, boundary=rectangulo)

# Listas vacías (Como pedir camiones vacíos para ir guardando el material de obra)
superficies_base = []
volumenes = []

# Configuramos la "semilla" del generador aleatorio para que los cambios no salten sin control
random.seed(seed)

# 4 al 7. Bucle de construcción (Parcela por parcela)
for celda in celdas:
    
    # 4. Retranqueo (Offset). 
    curvas_offset = gh.OffsetCurve(celda, -offset_dist, plano, 1)
    
    # Verificamos que el offset no haya fallado (que no esté vacío)
    if curvas_offset:
        
        # PREVENCIÓN DE ERRORES: Comprobamos si el resultado es una lista o un elemento suelto
        if isinstance(curvas_offset, list):
            # Si es una lista (una caja de curvas), sacamos la primera
            curva_interior = curvas_offset[0]
        else:
            # Si NO es una lista, es la curva suelta directamente
            curva_interior = curvas_offset
            
        # 5. Losa de cimentación (Superficie)
        # Nota importante: BoundarySurfaces SIEMPRE exige que le entregues los planos 
        # dentro de una lista, por eso aquí sí envolvemos la curva en corchetes [ ]
        superficie = gh.BoundarySurfaces([curva_interior])
        superficies_base.append(superficie)
        
        # 6. Altura Aleatoria
        altura_azar = random.uniform(h_min, h_max)
        
        # 7. Extrusión
        centro = gh.Area(curva_interior)[1]
        linea_eje = gh.LineSDL(centro, rg.Vector3d.ZAxis, altura_azar)
        
        extrusion = gh.Extrude(superficie, linea_eje)
        volumenes.append(extrusion)

# Salidas (Outputs)
a = volumenes
b = superficies_base
# ---------- end script ----------
panel = Panel(script.out)
panel_2 = Panel(script.b)
panel_3 = Panel(script.a)

construct_domain = ConstructDomain(DomainStart=number_slider_2, DomainEnd=number_slider_3)
gradient = Gradient(
    LowerLimit=number_slider_2,
    UpperLimit=number_slider_3,
    Parameter=construct_domain,
    stops=[0.0284: RGB(241, 246, 246), 0.224: RGB(245, 223, 187), 0.464: RGB(125, 200, 181), 0.68: RGB(18, 116, 117), 0.965: RGB(242, 84, 45)])
geometry = Geometry(script.b)
create_material = CreateMaterial(Diffuse=RGB(255, 105, 180), Specular=RGB(255, 255, 255), Emission=RGB(0, 0, 0), Transparency=0, Shine=0)
geometry_2 = Geometry(script.a)
custom_preview = CustomPreview(Geometry=geometry_2, Material=gradient)
